# Dynamo graph Warning Element Isolate In View.dyn (Dynamo 2.13.1.3887)
# packages: archi-lab.net 2016.13.1, Quasar 2.1.3

file_path = Filename(".\rac_advanced_sample_project_Error Report.html")
parseHtml = Archilab.Grimshaw.Elements.Warning.ParseHtml(filePath=file_path)
# note: Contact premtalreja7@gmail.com for any queries
elements = Archilab.Grimshaw.Elements.Warning.Elements(warning=parseHtml)
id = Archilab.Grimshaw.Elements.WarningElement.Id(warningElement=elements)
code_block = CodeBlock { 1; }
flatten = List.Flatten(list=id, amount=code_block)
element_by_id = ElementById(Id=flatten)
activeView = Quasar.ViewUtility.ActiveView()
isolate_in_view = Custom[Isolate in View](Element=element_by_id, View=activeView)  # package archi-lab.net; This node will take input of elements and a view to isolate selected elements in a view.
