# Dynamo graph Warning Element Override Color In View.dyn (Dynamo 2.13.1.3887)
# packages: archi-lab.net 2016.13.1

file_path = Filename(".\rac_advanced_sample_project_Error Report.html")
parseHtml = Archilab.Grimshaw.Elements.Warning.ParseHtml(filePath=file_path)
# note: Contact premtalreja7@gmail.com for any queries
elements = Archilab.Grimshaw.Elements.Warning.Elements(warning=parseHtml)
id = Archilab.Grimshaw.Elements.WarningElement.Id(warningElement=elements)
code_block = CodeBlock { 1; }
flatten = List.Flatten(list=id, amount=code_block)
element_by_id = ElementById(Id=flatten)
code_block_2 = CodeBlock { 255; }
byARGB = Color.ByARGB(red=code_block_2)
overrideColorInView = Element.OverrideColorInView(element=element_by_id, color=byARGB)
